% Simulink data dictionary DBR_V002.sldd

SysPwrMd_en_t = enum(DefaultValue="off")
  off = 0
  acc = 1
  run = 2
  crank_request = 3

PdlFlMdSts_en_t = enum(DefaultValue="normal")
  normal = 0
  comfort = 1
  sport = 2

VehMd_en_t = enum(DefaultValue="Nodriving")
  Nodriving = 0
  supereco = 1
  eco = 2
  normal = 3
  sport = 4
  super_sport = 5
  reserved = 6
  customer = 7

K_DBR_PTSToDecel_normal_Table = Simulink.Parameter([0 0
 120 0
 200 4
 333 12
 445 19
 526 25
 629 32
 730 39
 850 47
 1182 71
 1440 97
 1500 108
 1600 161
 1800 180
 2000 200], DataType="uint16")

K_DBR_PTSToDecel_comfort_Table = Simulink.Parameter([0 0
 120 0
 200 3
 333 10
 445 15
 526 19
 629 25
 730 31
 1000 50
 1275 71
 1400 82
 1500 96
 1600 150
 1800 180
 2000 190], DataType="uint16")

K_DBR_PTSToDecel_sport_Table = Simulink.Parameter([0 0
 120 0
 207 5
 288 11
 405 21
 540 33
 650 43
 750 52
 850 61
 965 71
 1350 109
 1500 130
 1600 180
 1800 190
 2000 210], DataType="uint16")

K_DBR_PTSToDecel_normal_cort_Table = Simulink.Parameter([0 0
 120 0
 200 4
 333 12
 445 19
 526 25
 629 37
 730 44
 850 52
 1182 76
 1440 102
 1500 114
 1600 170
 1800 185
 2000 205], DataType="uint16")

K_DBR_PTSToDecel_comfort_cort_Table = Simulink.Parameter([0 0
 120 0
 200 3
 333 10
 445 15
 526 19
 629 30
 730 36
 1000 55
 1275 76
 1400 87
 1500 103
 1600 155
 1800 185
 2000 195], DataType="uint16")

K_DBR_PTSToDecel_sport_cort_Table = Simulink.Parameter([0 0
 120 0
 207 5
 288 11
 405 21
 540 33
 650 48
 750 57
 850 66
 965 76
 1350 114
 1500 138
 1600 185
 1800 195
 2000 215], DataType="uint16")

K_DBR_FrceToDecel_normal_Table = Simulink.Parameter([0 0
 20 0
 21 4
 23 10
 24 19
 26 26
 29 32
 32 39
 37 45
 61 70
 84 97
 101 161
 125 190
 163 200], DataType="uint16")

K_DBR_FrceToDecel_comfort_Table = Simulink.Parameter([0 0
 20 0
 21 3
 23 9
 24 15
 26 20
 29 25
 32 31
 37 38
 61 61
 84 82
 101 150
 125 180
 163 190], DataType="uint16")

K_DBR_FrceToDecel_sport_Table = Simulink.Parameter([0 0
 20 0
 21 5
 23 12
 24 25
 26 33
 29 41
 32 50
 37 64
 61 87
 84 112
 101 180
 125 200
 163 210], DataType="uint16")

K_DBR_barToFrce_Table = Simulink.Parameter([0 0
 1 20
 2 21
 3 25
 4 33
 8 38
 13 45
 25 51
 35 61
 48 73
 60 84
 75 95
 90 101
 105 113
 120 125
 135 145
 150 163], DataType="uint16")

EPTRy_en_t = enum(DefaultValue="not_ready")
  not_ready = 0
  ready = 1

K_DBR_coDBRDecelFactor_u16 = Simulink.Parameter(80, DataType="uint16")
K_DBR_aDBRDecelSftLow_CST_u16 = Simulink.Parameter(200, DataType="uint16")
K_DBR_aDBRDecelEmgHigh_CST_u16 = Simulink.Parameter(500, DataType="uint16")

ACCSysSts_en_t = enum(DefaultValue="off")
  off = 0
  stand_by = 1
  active = 2
  override = 3
  brake_only = 4
  standstill_active = 5
  standstill_wait = 6
  passive = 7

ACCReqSts_en_t = enum(DefaultValue="no_request")
  no_request = 0
  deceleration_request = 1

ACCSdslReqSts_en_t = enum(DefaultValue="no_request")
  no_request = 0
  request = 1

ACCGoReqSts_en_t = enum(DefaultValue="no_request")
  no_request = 0
  request = 1

CHACCResp_en_t = enum(DefaultValue="no_request")
  no_request = 0
  request_honoured = 1
  lost_arbitration = 2
  control_not_allowed = 3
  precondition_not_satisfied = 4

ACCVehSpdLvl_en_t = enum(DefaultValue="over_speed")
  over_speed = 0
  normal_speed = 1
  low_speed = 2
  standstill = 3

K_DBR_velVehSpdLow_CST_s16 = Simulink.Parameter(14, DataType="int16")
K_EBR_velACCVehSpdHiLim_u16 = Simulink.Parameter(431, DataType="uint16")
K_EBR_velACCVehSpdLoLim_u16 = Simulink.Parameter(14, DataType="uint16")
W_Cntr_HiSpd_u8 = Simulink.Parameter(0, DataType="uint8")
W_Cntr_NrmlSpd_u8 = Simulink.Parameter(0, DataType="uint8")
W_Cntr_LoSpd_u8 = Simulink.Parameter(0, DataType="uint8")
W_Cntr_Stdstl_u8 = Simulink.Parameter(0, DataType="uint8")
K_Cntr_HiSpd_u8 = Simulink.Parameter(10, DataType="uint8")
K_Cntr_NrmlSpd_u8 = Simulink.Parameter(10, DataType="uint8")
K_Cntr_LowSpd_u8 = Simulink.Parameter(10, DataType="uint8")
K_Cntr_Sdstl_u8 = Simulink.Parameter(10, DataType="uint8")

ACCStdbySkpSts_en_t = enum(DefaultValue="off")
  off = 0
  control_brake = 1
  self_brake = 2
  standby = 3

ACCBrkSkpSts_en_t = enum(DefaultValue="standby")
  standby = 0
  control_brake = 1
  self_brake = 2
  hold = 3

ACCHldSkpSts_en_t = enum(DefaultValue="standby")
  standby = 0
  control_brake = 1
  self_brake = 2
  hold = 3
  EPB = 4

ACCEPBSts_en_t = enum(DefaultValue="not_apply")
  not_apply = 0
  apply = 1

ACCDrvrDorOpnSts_en_t = enum(DefaultValue="closed")
  closed = 0
  latch_switch_cant_detect = 1
  door_ajar = 2
  door_full_open = 3

ACCSebltSts_en_t = enum(DefaultValue="not_wear_seat_belt")
  not_wear_seat_belt = 0
  wear_seat_belt = 1

CHACCEPBReq_en_t = enum(DefaultValue="no_request")
  no_request = 0
  release_request = 1
  apply_request = 2

K_EBRACC_ramp_upper = Simulink.Parameter(2, DataType="int8")
K_EBRACC_ramp_lower = Simulink.Parameter(-2, DataType="int8")
K_DBR_velPdlDistSpdHi_lim = Simulink.Parameter(200, DataType="uint16")
K_DBR_aDBRDecelStdlstlDegdlvl1_u16 = Simulink.Parameter(600, DataType="uint16")
K_DBR_aDBRDecelStdlstlDegdlvl2_u16 = Simulink.Parameter(1200, DataType="uint16")
K_DBR_lenDBRStdlstlDegdlvl_u16 = Simulink.Parameter(1800, DataType="uint16")
K_EBR_aACCHold_flat_u16 = Simulink.Parameter(200, DataType="uint16")
K_EBR_ACCcountLim = Simulink.Parameter(1000, DataType="uint16")
W_EBR_ACCcount = Simulink.Parameter(0, DataType="uint16")
W_EBR_ACCSBEntrDecel_u16 = Simulink.Parameter(0, DataType="uint16")
W_EBR_velACCSBEntrVehSpd_u16 = Simulink.Parameter(0, DataType="uint16")
K_EBR_ACCSBDeclSlope = Simulink.Parameter(1, DataType="single")
K_EBR_ACCSBminDecl = Simulink.Parameter(100, DataType="uint16")
K_EBR_velACCVehSpdStdstllToLo_u16 = Simulink.Parameter(3, DataType="uint16")
K_EBR_velACCVehSpdLoToNrml_u16 = Simulink.Parameter(17, DataType="uint16")
K_EBR_velACCVehSpdNrmlToHigh_u16 = Simulink.Parameter(433, DataType="uint16")
K_DBR_velPdlDistSpdHilim_buffer = Simulink.Parameter(5, DataType="uint16")
K_EBR_velACCVehSpdLoToStdstll_u16 = Simulink.Parameter(1, DataType="uint16")
K_DBR_coDBRDecelFactor1 = Simulink.Parameter(5, DataType="uint8")
K_EBR_velACCVehSpdLim_buffer = Simulink.Parameter(1, DataType="uint16")
K_DBR_coDBRDecelFactor2 = Simulink.Parameter(3, DataType="uint8")
K_DBR_velDBRCSTlowVehSpd_u16 = Simulink.Parameter(8, DataType="uint16")
K_CSTCtol_ramp_upper = Simulink.Parameter(800, DataType="int16")
K_CSTCtol_ramp_lower = Simulink.Parameter(-800, DataType="int16")

ACCResp_en_t = enum(DefaultValue="no_request")
  no_request = 0
  request_honoured = 1
  lost_arbitration = 2
  control_not_allowed = 3
  precondition_not_satisfied = 4

K_CSTCtol_ramp_lower1 = Simulink.Parameter(-800, DataType="int16")
K_CSTCtol_ramp_upper1 = Simulink.Parameter(800, DataType="int16")
K_EBR_blACCEPBSwch_bl = Simulink.Parameter(0, DataType="boolean")
K_DBR_velCSTPdlDistSpdLmt_s16 = Simulink.Parameter(100, DataType="int16")
K_EBR_ACCSBDeclEterDecl_u16 = Simulink.Parameter(200, DataType="uint16")
K_EBR_ACC_ramp_lower = Simulink.Parameter(-800, DataType="int16")
K_EBR_ACC_ramp_upper = Simulink.Parameter(800, DataType="int16")

ACCFalCseSts_en_t = enum(DefaultValue="no_error")
  no_error = 0
  fail_cause1 = 1
  fail_cause2 = 2
  fail_cause3 = 3
  fail_cause4 = 4
  fail_cause5 = 5

V_EBR_aACCReqValue_u16 = Simulink.Signal(StorageClass="ExportToFile", HeaderFile="test_signal.h", DataType="uint16")
K_DBR_aDBRCSTminDecel = Simulink.Parameter(100, StorageClass="ExportToFile", HeaderFile="test_signal.h", DataType="uint16")
V_DBR_aDBRDecelRawReq_u16 = Simulink.Signal(StorageClass="ImportedExtern", DataType="uint16")
V_VDS_aAccLong_s16 = Simulink.Signal(StorageClass="ImportedExtern", DataType="int16")
V_VDS_degRdSlopeLong_s16 = Simulink.Signal(StorageClass="ImportedExtern", DataType="int16")
V_EBR_stCHACCResp_en = Simulink.Signal(StorageClass="ImportedExtern", DataType="Enum: CHACCResp_en_t")
V_EBR_stCHACCEPBReq_en = Simulink.Signal(StorageClass="ImportedExtern", DataType="Enum: CHACCEPBReq_en_t")
V_EBR_stACCVehSpdLvl_en = Simulink.Signal(StorageClass="ImportedExtern", DataType="Enum: ACCVehSpdLvl_en_t")
V_EBR_stACCSysSts_en = Simulink.Signal(StorageClass="ImportedExtern", DataType="Enum: ACCSysSts_en_t")
V_EBR_stACCStdbySkpSts_en = Simulink.Signal(StorageClass="ImportedExtern", DataType="Enum: ACCStdbySkpSts_en_t")
V_EBR_stACCSebltSts_en = Simulink.Signal(StorageClass="ImportedExtern", DataType="Enum: ACCSebltSts_en_t")
V_EBR_stACCSdslReqSts_en = Simulink.Signal(StorageClass="ImportedExtern", DataType="Enum: ACCSdslReqSts_en_t")
V_EBR_stACCReqSts_en = Simulink.Signal(StorageClass="ImportedExtern", DataType="Enum: ACCReqSts_en_t")
V_EBR_stACCHldSkpSts_en = Simulink.Signal(StorageClass="ImportedExtern", DataType="Enum: ACCHldSkpSts_en_t")
V_EBR_stACCGoReqSts_en = Simulink.Signal(StorageClass="ImportedExtern", DataType="Enum: ACCGoReqSts_en_t")
V_EBR_stACCFalCseSts_en = Simulink.Signal(StorageClass="ImportedExtern", DataType="Enum: ACCFalCseSts_en_t")
V_EBR_stACCEPBSts_en = Simulink.Signal(StorageClass="ImportedExtern", DataType="Enum: ACCEPBSts_en_t")
V_EBR_stACCDrvrDorOpnSts_en = Simulink.Signal(StorageClass="ImportedExtern", DataType="Enum: ACCDrvrDorOpnSts_en_t")
V_EBR_stACCBrkSkpSts_en = Simulink.Signal(StorageClass="ImportedExtern", DataType="Enum: ACCBrkSkpSts_en_t")
V_EBR_blTCSEble_bl = Simulink.Signal(StorageClass="ImportedExtern", DataType="boolean")
V_EBR_blAYCEble_bl = Simulink.Signal(StorageClass="ImportedExtern", DataType="boolean")
V_DBR_vldPdlFrceVD_bl = Simulink.Signal(StorageClass="ImportedExtern", DataType="boolean")
V_DBR_vldPdlFlMdVD_bl = Simulink.Signal(StorageClass="ImportedExtern", DataType="boolean", InitialValue="1")
V_DBR_vldPdlDistVD_bl = Simulink.Signal(StorageClass="ImportedExtern", DataType="boolean")
V_DBR_vldPdlDistSpdVD_bl = Simulink.Signal(StorageClass="ImportedExtern", DataType="boolean")
V_DBR_vldDBRDecelVD_bl = Simulink.Signal(StorageClass="ImportedExtern", DataType="boolean")
V_DBR_vldBrkPressSimVD_bl = Simulink.Signal(StorageClass="ImportedExtern", DataType="boolean")
V_DBR_velVehSpd_s16 = Simulink.Signal(StorageClass="ImportedExtern", DataType="int16")
V_DBR_velPdlDistSpd_s16 = Simulink.Signal(StorageClass="ImportedExtern", DataType="int16")
V_DBR_stVehStdlSts_bl = Simulink.Signal(StorageClass="ImportedExtern", DataType="boolean")
V_DBR_stVehMd_en = Simulink.Signal(StorageClass="ImportedExtern", DataType="Enum: VehMd_en_t")
V_DBR_stSysPwrMd_en = Simulink.Signal(StorageClass="ImportedExtern", DataType="Enum: SysPwrMd_en_t", InitialValue="0")
V_DBR_stPdlMdSlctEble_bl = Simulink.Signal(StorageClass="ImportedExtern", DataType="boolean")
V_DBR_stPdlFlMdSts_en = Simulink.Signal(StorageClass="ImportedExtern", DataType="Enum: PdlFlMdSts_en_t")
V_DBR_stPdlFlMdCstm_en = Simulink.Signal(StorageClass="ImportedExtern", DataType="Enum: PdlFlMdSts_en_t")
V_DBR_stPdlFlMdActlSts_en = Simulink.Signal(StorageClass="ImportedExtern", DataType="Enum: PdlFlMdSts_en_t")
V_DBR_stPdlFlMd_en = Simulink.Signal(StorageClass="ImportedExtern", DataType="Enum: PdlFlMdSts_en_t", InitialValue="0")
V_DBR_stPdlAply_bl = Simulink.Signal(StorageClass="ImportedExtern", DataType="boolean", InitialValue="0")
V_DBR_stEPTRy_en = Simulink.Signal(StorageClass="ImportedExtern", DataType="Enum: EPTRy_en_t")
V_DBR_pBrkPressSim_u16 = Simulink.Signal(StorageClass="ImportedExtern", DataType="uint16")
V_DBR_lenPdlDist_s16 = Simulink.Signal(StorageClass="ImportedExtern", DataType="int16")
V_DBR_FoPdlFrce_u16 = Simulink.Signal(StorageClass="ImportedExtern", DataType="uint16")
V_DBR_blTCSA_bl = Simulink.Signal(StorageClass="ImportedExtern", DataType="boolean")
V_DBR_blLosDecel_bl = Simulink.Signal(StorageClass="ImportedExtern", DataType="boolean")
V_DBR_blCSTSysFail_bl = Simulink.Signal(StorageClass="ImportedExtern", DataType="boolean")
V_DBR_blAYCA_bl = Simulink.Signal(StorageClass="ImportedExtern", DataType="boolean")
V_DBR_blABSA_bl = Simulink.Signal(StorageClass="ImportedExtern", DataType="boolean")
V_EBR_aCHACCDecelReq_u16 = Simulink.Signal(StorageClass="ImportFromFile", HeaderFile="EBRDBR.h", DataType="uint16")
V_DBR_EBR_stBrkArbMode_en = Simulink.Signal(StorageClass="ImportFromFile", HeaderFile="DBREBR.h", DataType="Enum: BrkArbMode_en_t")
V_DBR_vldTrShftLvrPosVD_bl = Simulink.Signal(StorageClass="ImportFromFile", HeaderFile="EBRDBR.h", DataType="boolean")
V_DBR_stTrShftLvrPos_en = Simulink.Signal(StorageClass="ImportFromFile", HeaderFile="EBRDBR.h", DataType="Enum: TrShftLvrPos_en_t")
V_DBR_aDBRDecelReq_u16 = Simulink.Signal(StorageClass="ImportFromFile", HeaderFile="EBRDBR.h", DataType="uint16")
V_DBR_stDBRCSTRunbleSts_en = Simulink.Signal(StorageClass="ImportFromFile", HeaderFile="EBRDBR.h", DataType="Enum: DBRCSTRunbleSts_en_t")
V_EBR_stCHACCRunbleSts_en = Simulink.Signal(StorageClass="ImportFromFile", HeaderFile="EBRDBR.h", DataType="Enum: CHACCRunbleSts_en_t")
K_DBR_blCSTSwch_bl = Simulink.Parameter(0, DataType="boolean")

TrShftLvrPos_en_t = enum(DataScope="Exported", HeaderFile="ApplBTA_DBREBR_enum_def.h", DefaultValue="BetweenRange")
  BetweenRange = 0
  ParkRange = 1
  ReverseRange = 2
  NeutralRange = 3
  ForwardA = 4
  ForwardB = 5
  ForwardC = 6
  ForwardD = 7
  ForwardE = 8
  ForwardF = 9
  ForwardG = 10
  ForwardH = 11
  Unknown = 12

CHACCRunbleSts_en_t = enum(DataScope="Exported", HeaderFile="ApplBTA_DBREBR_enum_def.h", DefaultValue="ACC_off")
  ACC_off = 0
  ACC_standby = 1
  ACC_CB = 2
  ACC_SB = 3
  ACC_HOLD = 4
  ACC_EPB = 5

DBRCSTRunbleSts_en_t = enum(DataScope="Exported", HeaderFile="ApplBTA_DBREBR_enum_def.h", DefaultValue="initial")
  initial = 0
  standstill_control = 1
  dynamic_control = 2
  CST_standby_standstill_control = 3
  CST_standby_dynamic_control = 4
  CST_active = 5
  CST_off = 6
  CST_emergency_control = 7

BrkArbMode_en_t = enum(DataScope="Exported", HeaderFile="ApplBTA_DBREBR_enum_def.h", DefaultValue="brake_no_request")
  brake_no_request = 0
  ACC_arbitration = 1
  DBR_arbitration = 2