% Simulink data dictionary LDM_DataDict.sldd

LDMCtrlMode_en_t = enum(DefaultValue="DecelCtrl")
  DecelCtrl = 0
  OLCtrl = 1
  SpeedCtrl = 2

LDMBrkArbMode_en_t = enum(DefaultValue="Standby")
  Standby = 0
  EBR_Standby = 1
  EBR_NormCtrl = 2
  EBR_SelfBrake = 3
  EBR_HldPres = 4
  EBR_Error = 5
  DBR_Init = 6
  DBR_NormCtrl = 7
  DBR_EmergCtrl = 8
  DBR_CST = 9
  DBR_HldPres = 10
  DBR_Error = 11

V_VDS_velVehSpd_f32 = Simulink.Signal(StorageClass="ImportFromFile", HeaderFile="EBRDBR.h", DataType="single")
V_VDS_aVehAccLong_f32 = Simulink.Signal(StorageClass="ImportFromFile", HeaderFile="EBRDBR.h", DataType="single")

LDMVehFwBw_en_t = enum(DefaultValue="Park")
  Backward = -1
  Park = 0
  Forward = 1
  Null = 2
  Error = 3

V_LDM_vldDecelCtrlerOutVD_bl = Simulink.Signal(StorageClass="ExportToFile", HeaderFile="ApplBTA_LDM_Signal.h", DataType="Enum: LDM_VLD_EN_T")
V_LDM_coCtrlerPCoeff_f32 = Simulink.Signal(StorageClass="ExportToFile", HeaderFile="ApplBTA_LDM_Signal.h", DataType="single")  % current P coefficience of Decel PID controller
V_LDM_torqDecelCtrlerOut_f32 = Simulink.Signal(StorageClass="ExportToFile", HeaderFile="ApplBTA_LDM_Signal.h", DataType="single", Unit="N*m")
V_LDM_torqDecelCtrlerOut = Simulink.Signal(StorageClass="ExportToFile", HeaderFile="ApplBTA_LDM_Signal.h", DataType="single", Unit="N*m")
V_LDM_stVehFwBw_en = Simulink.Signal(StorageClass="ExportToFile", HeaderFile="ApplBTA_LDM_Signal.h", DataType="Enum: LDMVehFwBw_en_t", InitialValue="LDMVehFwBw_en_t.Park")
V_LDM_stCtrlMode_en = Simulink.Signal(StorageClass="ExportToFile", HeaderFile="ApplBTA_LDM_Signal.h", DataType="Enum: LDMCtrlMode_en_t", InitialValue="LDMCtrlMode_en_t.DecelCtrl")
V_LDM_stBrkSrcMode_en = Simulink.Signal(StorageClass="ExportToFile", HeaderFile="ApplBTA_LDM_Signal.h", DataType="Enum: LDM_BRK_SRC_MODE_EN_T")
V_LDM_stBrkArbMode_en = Simulink.Signal(StorageClass="ExportToFile", HeaderFile="ApplBTA_LDM_Signal.h", DataType="Enum: LDMBrkArbMode_en_t", InitialValue="LDMBrkArbMode_en_t.Standby")
V_LDM_resetCtrlerVal = Simulink.Signal(StorageClass="ExportToFile", HeaderFile="ApplBTA_LDM_Signal.h", DataType="single")
V_LDM_resetCtrler_bl = Simulink.Signal(StorageClass="ExportToFile", HeaderFile="ApplBTA_LDM_Signal.h", DataType="boolean")  % Controller reset signal, either rising and falling will reset the I part of controller output.
V_LDM_PrvCtrlerOut = Simulink.Signal(StorageClass="ExportToFile", HeaderFile="ApplBTA_LDM_Signal.h", DataType="single")  % Previous output of controller.
V_LDM_coCtrlerPCoeff = Simulink.Signal(StorageClass="ExportToFile", HeaderFile="ApplBTA_LDM_Signal.h", DataType="single")  % current P coefficience of Decel PID controller
V_LDM_coCtrlerICoeff_f32 = Simulink.Signal(StorageClass="ExportToFile", HeaderFile="ApplBTA_LDM_Signal.h", DataType="single")
V_LDM_coCtrlerICoeff = Simulink.Signal(StorageClass="ExportToFile", HeaderFile="ApplBTA_LDM_Signal.h", DataType="single")
V_LDM_blClsCtrlIpartEnable = Simulink.Signal(StorageClass="ExportToFile", HeaderFile="ApplBTA_LDM_Signal.h", DataType="boolean")
V_LDM_aVehAccErr = Simulink.Signal(StorageClass="ExportToFile", HeaderFile="ApplBTA_LDM_Signal.h", DataType="single")  % Feedback error of Decel Controller.
V_LDM_aVehAccDecLong = Simulink.Signal(StorageClass="ExportToFile", HeaderFile="ApplBTA_LDM_Signal.h", DataType="single")
V_LDM_aCtrlerSetpoint_f32 = Simulink.Signal(StorageClass="ExportToFile", HeaderFile="ApplBTA_LDM_Signal.h", DataType="single")
V_LDM_aCtrlerSetpoint = Simulink.Signal(StorageClass="ExportToFile", HeaderFile="ApplBTA_LDM_Signal.h", DataType="single")
V_LDM_aCtrlErr_f32 = Simulink.Signal(StorageClass="ExportToFile", HeaderFile="ApplBTA_LDM_Signal.h", DataType="single")  % Feedback error of Decel Controller.
V_LDM_aCtrlErr = Simulink.Signal(StorageClass="ExportToFile", HeaderFile="ApplBTA_LDM_Signal.h", DataType="single")  % Feedback error of Decel Controller.
K10_LDM_aOLCtrlerTableX = Simulink.Parameter([0 0.5 1 2 3 4 5 6 7 8], StorageClass="ExportToFile", HeaderFile="ApplBTA_LDM_Param.h", DataType="single")  % Input breakpoints of table for open loop controller (from decel request to brake torq)
K_LDM_torqOLCtrlerUpLim = Simulink.Parameter(20000, StorageClass="ExportToFile", HeaderFile="ApplBTA_LDM_Param.h", DataType="single", Unit="N*m")
K_LDM_torqOLCtrlerResetLim = Simulink.Parameter(10, StorageClass="ExportToFile", HeaderFile="ApplBTA_LDM_Param.h", DataType="single")
K_LDM_torqOLCtrlerLowLim = Simulink.Parameter(0, StorageClass="ExportToFile", HeaderFile="ApplBTA_LDM_Param.h", DataType="single", Unit="N*m")
K_LDM_torqOLCtrlerIncRate = Simulink.Parameter(2, StorageClass="ExportToFile", HeaderFile="ApplBTA_LDM_Param.h", DataType="single")
K_LDM_torqOLCtrlerDecRate = Simulink.Parameter(2, StorageClass="ExportToFile", HeaderFile="ApplBTA_LDM_Param.h", DataType="single")
K_LDM_torqDecelCtrlerUpLim = Simulink.Parameter(20000, StorageClass="ExportToFile", HeaderFile="ApplBTA_LDM_Param.h", DataType="single", Unit="N*m")
K_LDM_torqDecelCtrlerLowLim = Simulink.Parameter(0, StorageClass="ExportToFile", HeaderFile="ApplBTA_LDM_Param.h", DataType="single", Unit="N*m")
K_LDM_coDecelParalCtrlEbrSB_I = Simulink.Parameter(500, StorageClass="ExportToFile", HeaderFile="ApplBTA_LDM_Param.h", DataType="single")
K_LDM_coDecelCtrlLowSpd_P = Simulink.Parameter(200, StorageClass="ExportToFile", HeaderFile="ApplBTA_LDM_Param.h", DataType="single")
K_LDM_coDecelCtrlLowSpd_I = Simulink.Parameter(5000, StorageClass="ExportToFile", HeaderFile="ApplBTA_LDM_Param.h", DataType="single")
K_LDM_coDecelCtrlHighSpd_I = Simulink.Parameter(5000, StorageClass="ExportToFile", HeaderFile="ApplBTA_LDM_Param.h", DataType="single")
K_LDM_coDecelCtrlEbrSB_P = Simulink.Parameter(50, StorageClass="ExportToFile", HeaderFile="ApplBTA_LDM_Param.h", DataType="single")
K_LDM_coDecelCtrlEbrSB_I = Simulink.Parameter(1000, StorageClass="ExportToFile", HeaderFile="ApplBTA_LDM_Param.h", DataType="single")
K_LDM_coDecelCtrlCST_P = Simulink.Parameter(50, StorageClass="ExportToFile", HeaderFile="ApplBTA_LDM_Param.h", DataType="single")
K_LDM_coDecelCtrlCST_I = Simulink.Parameter(1000, StorageClass="ExportToFile", HeaderFile="ApplBTA_LDM_Param.h", DataType="single")
K_LDM_blClsLoopCtrlEnable_bl = Simulink.Parameter(0, StorageClass="ExportToFile", HeaderFile="ApplBTA_LDM_Param.h", DataType="boolean")
K_LDM_torqDecelClsCtrlerUpLim = Simulink.Parameter(1000, StorageClass="ExportToFile", HeaderFile="ApplBTA_LDM_Param.h", DataType="single", Unit="N*m")
K_LDM_torqDecelClsCtrlerLowLim = Simulink.Parameter(-1000, StorageClass="ExportToFile", HeaderFile="ApplBTA_LDM_Param.h", DataType="single", Unit="N*m")
K_LDM_coDecelParalCtrlHighSpd_P = Simulink.Parameter(300, StorageClass="ExportToFile", HeaderFile="ApplBTA_LDM_Param.h", DataType="single")
K_LDM_coDecelParalCtrlHighSpd_I = Simulink.Parameter(2000, StorageClass="ExportToFile", HeaderFile="ApplBTA_LDM_Param.h", DataType="single")
K_LDM_coDecelCtrlOl2ClLim = Simulink.Parameter(3, StorageClass="ExportToFile", HeaderFile="ApplBTA_LDM_Param.h", DataType="single", Unit="km/hr")
K_LDM_coDecelCtrlCl2OlLim = Simulink.Parameter(2, StorageClass="ExportToFile", HeaderFile="ApplBTA_LDM_Param.h", DataType="single", Unit="km/hr")
K_LDM_coDecelCtrlHighSpd_P = Simulink.Parameter(300, StorageClass="ExportToFile", HeaderFile="ApplBTA_LDM_Param.h", DataType="single")
K_LDM_coDecelParalCtrlLowSpd_P = Simulink.Parameter(150, StorageClass="ExportToFile", HeaderFile="ApplBTA_LDM_Param.h", DataType="single")
K_LDM_coDecelParalCtrlLowSpd_I = Simulink.Parameter(500, StorageClass="ExportToFile", HeaderFile="ApplBTA_LDM_Param.h", DataType="single")
K_LDM_coDecelParalCtrlEbrSB_P = Simulink.Parameter(150, StorageClass="ExportToFile", HeaderFile="ApplBTA_LDM_Param.h", DataType="single")
K_LDM_coDecelParalCtrlCST_P = Simulink.Parameter(150, StorageClass="ExportToFile", HeaderFile="ApplBTA_LDM_Param.h", DataType="single")
K_LDM_coDecelParalCtrlCST_I = Simulink.Parameter(500, StorageClass="ExportToFile", HeaderFile="ApplBTA_LDM_Param.h", DataType="single")
K10_LDM_torqOLCtrlerTableY = Simulink.Parameter([0 241.5 667 1552.5 2311.5 3277.5 4025 4772.5 5865 7245], StorageClass="ExportToFile", HeaderFile="ApplBTA_LDM_Param.h", DataType="single")  % Output breakpoints of table for open loop controller (from decel request to brake torq)
K_LDM_coDecelCtrlHigh2LowLim = Simulink.Parameter(20, StorageClass="ExportToFile", HeaderFile="ApplBTA_LDM_Param.h", DataType="single", Unit="km/hr")
K_LDM_coDecelCtrlLow2HighLim = Simulink.Parameter(22, StorageClass="ExportToFile", HeaderFile="ApplBTA_LDM_Param.h", DataType="single", Unit="km/hr")

LDM_BRK_SRC_MODE_EN_T = enum(DataScope="Exported", HeaderFile="ApplBTA_LDM_DataType.h", DefaultValue="BTA_EXTERNAL_BRAKE")
  BTA_EXTERNAL_BRAKE = 0
  BTA_PEDAL_APPLIED = 1
  BTA_PEDAL_BRAKE_NONE = 2

LDM_VLD_EN_T = enum(DataScope="Exported", HeaderFile="ApplBTA_LDM_DataType.h", DefaultValue="VALID")
  VALID = 0
  INVALID = 1